vi "Main.gviweb"   [LabVIEW NXG 2.1.0]
panel controls:
  "Slider": f64
  "Numeric": f64 = 300000
  "Slider_3": f64
panel indicators:
  "Tank": f64
  "Graph": f64[][]
  "Gauge": f64
  "URL Image_2": string
  "LED": bool
diagram:
  disable {
    frame Enabled { }
    frame Disabled {
      while {
        Wait(time to wait=150)
        Add($Slider)
        stop if FALSE
      }
    }
  }
  while {
    Wait(time to wait=150)
    Random Number() -> (number (0 to 1)=w1)
    Multiply(w1, 5000) -> w2
    Add($Slider_3, w2, $Numeric) -> w3
    $Gauge <- w3
    Is Greater(x=w3, y=400000) -> w4
    $LED <- w4
    stop if FALSE
  }
  while {
    for (N = 100) (iteration -> i1) {
      Divide(x=i1, y=10) -> w7
      Sine(x=w7) -> w8
      Random Number() -> (number (0 to 1)=w9)
      Add(w8, w9) -> w10
      Random Number() -> (number (0 to 1)=w11)
      Divide(x=w11, y=10) -> w12
      Add(w12, 1) -> w13
      append w10 to w5
      append w13 to w6
    }
    Build Array(w5, w6) -> w14
    $Graph <- w14
    Wait(time to wait=60)
    stop if FALSE
  }
